# Grasshopper definition Architectural Facade.gh (Grasshopper 1.0.7)

panel = Panel("D:\Intro Program Design\Final_Assignment_A50\image_2021.png")
scale = Slider(0.02, range=0..0.2)
panel_2 = Panel("D:\Intro Program Design\Final_Assignment_A50\sunVectors.csv")
col = Colour("3,186,226")
surfacefromimage = CSharpScript(
    path=panel,
    color=col,
    degU=Slider(2, range=0..10),
    degV=Slider(2, range=0..10),
    sinRadius=Slider(1, range=0..10),
    waveScale=scale)  # -> out, srf, pixelPts; inputs path: String, color: Int32, degU: Int32, degV: Int32, sinRadius: Double, waveScale: Double
# ---------- surfacefromimage: C# usings ----------
using System.Drawing;
# ---------- surfacefromimage: C# ----------
    //call class
    var sffi = new SurfaceFromImage(path,color,degU,degV, sinRadius,waveScale);
    
    //call function
    List<Point3d> p = sffi.Getpoints(path, color);
    NurbsSurface surface = sffi.GenerateSurface(degU, degV);
    surface = sffi.setControlPoint(path, degU, degV, sinRadius, waveScale);
    surface = sffi.getKnotsSurface(degU, degV);
    
    //output
    srf = surface;
    pixelPts = p;
# ---------- surfacefromimage: C# additional code ----------
  //create class
  public class SurfaceFromImage
  { 
    //create properties
    public string path;
    public int color;
    public int degU;
    public int degV;
    public double sinRadius;
    public double waveScale;
    public NurbsSurface srfSin;

    //store for the points
    List<int> PointI = new List<int>();
    List<int> PointJ = new List<int>();
    List<Point3d> cpts = new List<Point3d>();
    
    //create class constructor
    public SurfaceFromImage(string _path, int _color, int _degU, int _degV, double _sinRadius, double _waveScale)
    {
      path = _path;
      color = _color;
      degU = _degU;
      degV = _degV;
      sinRadius = _sinRadius;
      waveScale = _waveScale;
    }
    //create methods
    //detect color and add points
    public List<Point3d> Getpoints(string path, int color)
    {
      List<Point3d> points = new List<Point3d>();

      Bitmap bitMap = new Bitmap(path);
      List<Color> cols = new List<Color>();

      for (int i = 0; i < bitMap.Width; i++)
      {
        for (int j = 0; j < bitMap.Height; j++)
        {
          Color colorPic = bitMap.GetPixel(i, j);

          if (colorPic == Color.FromArgb(color))
          {
            cols.Add(colorPic);

            points.Add(new Point3d(i, -j + bitMap.Height, 0));

            if(!PointI.Contains(i)){PointI.Add(i);}
            if(!PointJ.Contains(j)){PointJ.Add(j);}
          }
        }
      }
      return points;
    }

    //get knots
    public double[] GenerateKnots(int degree, int num)
    {
      double[] knots = new double[degree - 1 + num];

      for(int i = 0;i < knots.Length;i++)
      {
        if(i < degree)
        {
          knots[i] = 0;
        }
        else if(i >= knots.Length - degree)
        {
          knots[i] = 1;
        }
        else
        {
          double factor = i - degree + 1;
          double knotValue = 1.0 / (num - degree);
          knots[i] = factor * knotValue;
        }
      }
      return knots;
    }

    //get surfaces
    public NurbsSurface GenerateSurface(int degU, int degV)
    {
      int numU = PointI.Count;
      int numV = PointJ.Count;

      srfSin = NurbsSurface.Create(3, true, degU + 1, degV + 1, numU, numV);
      return srfSin;
    }

    //get points on the surface
    public NurbsSurface setControlPoint(string path, int degU, int degV, double sinRadius, double waveScale)
    {
      Bitmap bitMap = new Bitmap(path);
      int numU = PointI.Count;
      int numV = PointJ.Count;

      for (int i = 0;i < numU;i++)
      {
        for(int j = 0; j < numV;j++)
        {

          Point3d cpt = new Point3d(PointI[i], -PointJ[j] + bitMap.Height, (sinRadius * Math.Sin(Math.Cos(waveScale * PointI[i]) * PointJ[j])) + 5);
          cpts.Add(cpt);
          srfSin.Points.SetPoint(i, j, cpt);
        }
      }
      return srfSin;
    }

    //set control points on the surface
    public NurbsSurface getKnotsSurface(int degU, int degV)
    {
      int numU = PointI.Count;
      int numV = PointJ.Count;

      double[] knotsU = GenerateKnots(degU, numU);
      double[] knotsV = GenerateKnots(degV, numV);


      for (int i = 0;i < knotsU.Length;i++)
      {
        srfSin.KnotsU[i] = knotsU[i];
      }
      for (int i = 0;i < knotsV.Length;i++)
      {
        srfSin.KnotsV[i] = knotsV[i];
      }

      for(int i = 0;i < numU; i++)
      {
        for(int j = 0;j < numV; j++)
        {
          int index = i * numV + j;
          ControlPoint cpt = new ControlPoint(cpts[index], 1);
          srfSin.Points.SetControlPoint(i, j, cpt);
        }
      }
      return srfSin;
    }
  }
# ---------- end surfacefromimage ----------
readsumvector = CSharpScript(path=panel_2)  # -> out, SunVectors; inputs path: String
# ---------- readsumvector: C# usings ----------
using System.IO;
using System.Linq;
# ---------- readsumvector: C# ----------
    //call functions
    SunVectors = AverageVec(SunInJune(path));
# ---------- readsumvector: C# additional code ----------
  //read vectors from CSV file
  public List<Vector3d> SunInJune(string path)
  {
    var sunV = new List<Vector3d>();

    List<double> xCoordinates = new List<double>();
    List<double> yCoordinates = new List<double>();
    List<double> zCoordinates = new List<double>();

    string[] lines = File.ReadAllLines(path);

    for (int i = 0; i < lines.Length; i++)
    {
      string[] coords = lines[i].Split(',');
      xCoordinates.Add(double.Parse(coords[0]));
      yCoordinates.Add(double.Parse(coords[1]));
      zCoordinates.Add(double.Parse(coords[2]));

      {
        sunV.Add(new Vector3d(double.Parse(coords[0]), double.Parse(coords[1]), double.Parse(coords[2])));
      }
    }
    return sunV;
  }
  //finding the average of vectors to compare normal surface of each panel in next component
  public Vector3d AverageVec(List<Vector3d> SunPath)
  {
    var avgVec = SunPath.Aggregate(new Vector3d(0, 0, 0), (s,v) => s + v) / (float) SunPath.Count;
    return avgVec;
  }
# ---------- end readsumvector ----------
img = ImportImage(File=panel)
panel_3 = Panel(readsumvector.out)
panel_4 = Panel(surfacefromimage.out)
srf = Surface(surfacefromimage.srf)
number_slider = Slider(10, range=0..100)
trigger = Trigger(Interval=100, TimerInterval=100, Target=panelization)  # disabled
panelization = CSharpScript(srf=srf, NumX=number_slider, NumY=number_slider, sunVectors=readsumvector.SunVectors, walkerReset=Button())  # -> out, A, B; inputs srf: Surface, NumX: Int32, NumY: Int32, sunVectors: Vector3d, walkerReset: Boolean
# ---------- panelization: C# ----------
    // call Mesh
    List<Mesh> meshlist = generatePanel(srf, NumX, NumY, sunVectors);

    //call walker
    Point3d newPosition = Walk(srf, NumX, NumY, walkerReset);

    //output
    A = meshlist;
    B = newPosition;
# ---------- panelization: C# additional code ----------
  //create method
  //create mesh from surface
  public Mesh meshFromSrf(Surface srf, int NumX, int NumY)
  {
    var m = new Mesh();

    srf.SetDomain(0, new Interval(0.0, 1.0));
    srf.SetDomain(1, new Interval(0.0, 1.0));

    double u = 1.0 / NumX;
    double v = 1.0 / NumY;

    for(int i = 0; i < NumX; i++)
    {
      for(int j = 0; j < NumY; j++)
      {

        Mesh subMsh = new Mesh();
        subMsh.Vertices.Add(srf.PointAt(i * u, j * v));
        subMsh.Vertices.Add(srf.PointAt((i + 1) * u, j * u));
        subMsh.Vertices.Add(srf.PointAt((i + 1) * u, (j + 1) * u));
        subMsh.Vertices.Add(srf.PointAt(i * u, (j + 1) * u));

        subMsh.Faces.AddFace(0, 2, 1);
        subMsh.Faces.AddFace(0, 2, 3);


        m.Append(subMsh);

      }
    }

    m.Vertices.CombineIdentical(true, true);
    m.FaceNormals.ComputeFaceNormals();
    return m;
  }

  //find the centre points
  Point3d CentrePoint(int meshfaceindex, Mesh m)
  {
    var center = new Point3d(0, 0, 0);

    center.X += m.Vertices[m.Faces[meshfaceindex].A].X;
    center.Y += m.Vertices[m.Faces[meshfaceindex].A].Y;
    center.Z += m.Vertices[m.Faces[meshfaceindex].A].Z;

    center.X += m.Vertices[m.Faces[meshfaceindex].B].X;
    center.Y += m.Vertices[m.Faces[meshfaceindex].B].Y;
    center.Z += m.Vertices[m.Faces[meshfaceindex].B].Z;

    center.X += m.Vertices[m.Faces[meshfaceindex].C].X;
    center.Y += m.Vertices[m.Faces[meshfaceindex].C].Y;
    center.Z += m.Vertices[m.Faces[meshfaceindex].C].Z;

    center.X /= 3;
    center.Y /= 3;
    center.Z /= 3;

    return center;
  }

  //compare normals angle with vector
  double diffAngle(Vector3d sunVectors, Mesh m, int meshfaceindex){
    var diffAngle = new double();

    Vector3d tangent = sunVectors - m.FaceNormals[meshfaceindex];

    diffAngle =
      Vector3d.VectorAngle(tangent, Vector3d.XAxis);
    Vector3d cross =
      Vector3d.CrossProduct(tangent, Vector3d.XAxis);

    return diffAngle;
  }

  //find distances between attractor points and centre points
  double diffDisAtt(Point3d Cen, Point3d attractors, Mesh m, int meshfaceindex){
    var diffDisAtt = new double();
    diffDisAtt = Math.Sqrt(Math.Pow((Cen.X - attractors.X), 2) + Math.Pow((Cen.Y - attractors.Y), 2));

    return diffDisAtt;
  }
  
  //create mesh panels
  public List<Mesh> generatePanel(Surface srf, int NumX, int NumY, Vector3d sunVectors)
  {
    //Create Mesh from surface
    List<Vector3d> normals = new List<Vector3d>();
    List<Point3d> Srfpt = new List<Point3d>();
    List<Point3d> Cpt = new List<Point3d>();
    Mesh m = meshFromSrf(srf, NumX, NumY);

    //Explode Mesh
    var meshlist = new List<Mesh>();

    for (int i = 0; i < m.Faces.Count; i++) {

      MeshFace face = m.Faces[i];

      Mesh newMesh = new Mesh();

      //Add the vertex of face.
      newMesh.Vertices.Add(m.Vertices[face.A]);
      newMesh.Vertices.Add(m.Vertices[face.B]);
      newMesh.Vertices.Add(m.Vertices[face.C]);

      Vector3d norm = new Vector3d(m.FaceNormals[i]);
      
      //move centre points according to normal vectors of each panels and distances following the factors(sunvector, attractor) 
      Point3d Cmove = CentrePoint(i, m) + norm * ((diffDisAtt(CentrePoint(i, m), srf.PointAt(uPos, vPos), m, i) / 10) - (diffAngle(sunVectors, m, i) / 3 ));

      newMesh.Vertices.Add(Cmove);

      //Add the MeshFace.
      newMesh.Faces.AddFace(3, 1, 2, 0);
      newMesh.Normals.ComputeNormals();
      newMesh.Compact();

      meshlist.Add(newMesh);
      Cpt.Add(CentrePoint(i, m));
    }
    return meshlist;
  }

  //create walker
  Random rand = new Random();
  
  //set initial state
  double uPos = 0.0;
  double vPos = 0.0;
  
  //array function
  Point3d Walk(Surface srf, int NumX, int NumY, bool walkerReset){
    
    //use u,v on surface to direct walker
    var walker = srf.PointAt(0.0, 0.0);
    double stepSize = 1.0 / NumX;

    double[] store = new double[2];

    //set a direction
    int direction = rand.Next(4);
    //South
    if(direction == 0 && uPos <= 1.0 - stepSize ){
      uPos += stepSize;}
      //North
    else if(direction == 1 && uPos > stepSize){
      uPos -= stepSize;}
      //East
    else if(direction == 2 && vPos <= 1.0 - stepSize ){
      vPos += stepSize;}
      //West
    else if(direction == 3 && vPos > stepSize){
      vPos -= stepSize;}
    //move in that direction
    store[0] = uPos;
    store[1] = vPos;

    if(walkerReset){
      uPos = new double();
      vPos = new double();
    }

    walker = srf.PointAt(uPos, vPos);
    return walker;
  }
# ---------- end panelization ----------
cloud = CloudDisplay(Points=panelization.B, Colours=ColourSwatch(SwatchColor=RGB(122, 255, 202)), Size=Slider(1, range=0..1), SpriteType=0)
mjoin = MeshJoin(Meshes=panelization.A)
panel_5 = Panel(panelization.out)
panel_6 = Panel("D:\Intro Program Design\Final_Assignment_A50\A50_NumXY15.txt")
serializemesh = CSharpScript(mesh=mjoin, txt=panel_6)  # -> out, data; inputs mesh: Mesh, txt: String
# ---------- serializemesh: C# usings ----------
using System.IO;
# ---------- serializemesh: C# ----------
    //call functions
    //combine stings
    string allData = "QUAD" + Environment.NewLine + FaceData(mesh) + Environment.NewLine + VerticeData(mesh);
    data = allData;

    //export .txt file in case data connot display in this panel
    File.WriteAllText(txt, allData);
# ---------- serializemesh: C# additional code ----------
  //create functions
  //write csv data from mesh faces
  public string FaceData(Mesh mesh)
  {
    var crrStrF = new string(new char[]{});
    List<string> quadfaces = new List<string>();

    for (int i = 0; i < mesh.Faces.Count; i++)
    {
      MeshFace f = mesh.Faces[i];

      //seperate data with comma
      quadfaces.Add(f.A + "," + f.B + "," + f.C + "," + f.D);

      //new string= old string+ new data
      crrStrF = crrStrF + "," + quadfaces[i];
    }
    return crrStrF;
  }

  //write csv data from mesh vertices
  public string VerticeData(Mesh mesh)
  {
    var crrStrV = new string(new char[]{});
    List<string> vertices = new List<string>();

    for (int k = 0; k < mesh.Vertices.Count; k++)
    {
      Point3d p = mesh.Vertices[k];

      //seperate data with comma
      vertices.Add(p.X + "," + p.Y + "," + p.Z);

      //new string= old string+ new data
      crrStrV = crrStrV + "," + vertices[k];
    }
    return crrStrV;
  }
# ---------- end serializemesh ----------
# If numX,numY are over than 10,
# the data is too large to display here.
# 
# So,I exported the data for NumX,NumY =15 in .txt file in the floder.
panel_7 = Panel(serializemesh.data)
panel_8 = Panel(serializemesh.out)
